# Grasshopper definition Classification.gh (Grasshopper 1.0.7)
# plug-ins: Pufferfish

# Hexagon Curves
# Amenities
curve = Curve([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])
# Parks
# Public Transport
data = Data(Tree({1}: ["12", "12", "11", "8", "4", "3", "0", "0", "2", "9"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], {2}: ["2", "2", "2", "0", "0", "0", "0", "0", "0", "0"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], {3}: ["4", "4", "5", "11", "12", "12", "14", "14", "10", "7"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]))
data_2 = Data([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])
data_3 = Data(Tree({1}: ["0.301182", "0.342825", "0.284495", "0.181715", "0.146827", "0.05615"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], {2}: ["3405.991345", "3502.110836", "3814.623091", "4403.491978", "5186.850109", "5678.610205"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], {3}: ["3531.819902", "3717.218651", "4086.491918", "4472.188433", "5015.663582", "5691.043978"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], {4}: ["0.007689", "0.005114", "0.007488", "0.017117", "0.014787", "0.035047"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], {5}: ["0", "0", "0", "0", "0", "0"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], {6}: ["0.006931", "0.010971", "0.006773", "0.002435", "0.002337", "0.002865"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], {7}: ["7.811251", "7.944987", "0", "11.5579", "0", "0"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], {8}: ["0.02299", "0.034569", "0.023609", "0.010901", "0.010626", "0.004203"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]))
bounding_box = BoundingBox(Content=flatten(curve), Plane=PlaneXY(0, 0, 0), UnionBox=True)  # -> Box, Box_2
number_slider = Slider(0.09, range=0.01..0.1)
rangevalue = Slider(2, range=1..10)
area = Area(Geometry=bounding_box.Box)  # -> Area, Centroid
panel = Panel(data_3)
panel_2 = Panel(data)
number = Number(0.1)
rangevalue_2 = GetNumber(rangevalue, AtLeast=1, AtMost=2147483647, Maximum=1.797693135e+308, Minimum=-1.797693135e+308)
scale = Scale(Geometry=data_2, Center=area.Centroid, Factor=number_slider)  # -> Geometry, Transform
scale_2 = Scale(Geometry=curve, Center=area.Centroid, Factor=number_slider)  # -> Geometry, Transform
series = Series(Start="1", Step=1, Count="8")
multiplication = Multiplication(A=rangevalue_2, B=number)
orient = Orient(Geometry=scale.Geometry, Source=area.Centroid, Target=PlaneXY(0, 0, 0))  # -> Geometry, Transform
panel_3 = Panel(rangevalue_2)
orient_2 = Orient(Geometry=scale_2.Geometry, Source=area.Centroid, Target=PlaneXY(0, 0, 0))  # -> Geometry, Transform
cull_index = CullIndex(List=series, Indices=expr("x-1", ["2", "3"]), Wrap=True)
tree_branch = TreeBranch(Tree=data_3, Path=["3", "2"], MaintainPaths=True)
tree_branch_2 = TreeBranch(Tree=data_3, Path=cull_index, MaintainPaths=True)
panel_4 = Panel(tree_branch_2)
bounds = Bounds(Numbers=tree_branch)
deconstruct_domain = DeconstructDomain(Domain=bounds)  # -> Start, End
replace_nulls = ReplaceNulls(Items=tree_branch_2, Replacements="0")  # -> Items, Count
construct_domain = ConstructDomain(DomainStart=deconstruct_domain.End, DomainEnd=deconstruct_domain.Start)
bounds_2 = Bounds(Numbers=replace_nulls.Items)
remap_numbers = RemapNumbers(Value=tree_branch, Source=construct_domain, Target=Domain(0, 1))  # -> Mapped, Clipped
remap_numbers_2 = RemapNumbers(Value=tree_branch_2, Source=bounds_2, Target=Domain(0, 1))  # -> Mapped, Clipped
flip_matrix = FlipMatrix(Data=remap_numbers.Mapped)
flip_matrix_2 = FlipMatrix(Data=remap_numbers_2.Mapped)
merge = Merge(Data1=flip_matrix, Data2=flip_matrix_2)
mass_addition = MassAddition(Input=merge)  # -> flatten(Result), PartialResults
bounds_3 = Bounds(Numbers=mass_addition.Result)
xy_plane = XYPlane(Origin=Point(0, 0, 0))
remap_numbers_3 = RemapNumbers(Value=mass_addition.Result, Source=bounds_3, Target=Domain(0, 1))  # -> Mapped, Clipped
region_union = RegionUnion(Curves=orient.Geometry, Plane=xy_plane)
graph_mapper = GraphMapper(remap_numbers_3.Mapped, x0=0, x1=1, y0=0, y1=1, container_name="Bezier", cpx=[0, 0.8399885893, 0, 1], cpy=[0, 0, 1, 1])
smaller_than = SmallerThan(FirstNumber=graph_mapper, SecondNumber=multiplication)  # -> SmallerThan, OrEqualTo
gradient = Gradient(LowerLimit=0, UpperLimit=1, Parameter=graph_mapper, stops=[0: RGB(0, 128, 0), 0.5: RGB(255, 255, 0), 1: RGB(255, 0, 0)])
curve_2 = Curve(orient_2.Geometry)
area_2 = Area(Geometry=curve_2)  # -> Area, Centroid
xy_plane_2 = XYPlane(Origin=Point(0, 0, 0))
region_union_2 = RegionUnion(Curves=orient.Geometry, Plane=xy_plane_2)
surface = Surface(curve_2)
dispatch = Dispatch(List=surface, DispatchPattern=smaller_than.SmallerThan)  # -> ListA, ListB
surface_2 = Surface(dispatch.ListA)
area_3 = Area(Geometry=surface_2)  # -> Area, Centroid
point_in_curve = PointInCurve(Point=area_3.Centroid, Curve=region_union)  # -> Relationship, Point
dispatch_2 = Dispatch(List=surface_2, DispatchPattern=point_in_curve.Relationship)  # -> ListA, ListB
surface_3 = Surface(dispatch_2.ListA)
area_4 = Area(Geometry=surface_3)  # -> Area, Centroid
area_5 = Area(Geometry=surface)  # -> Area, Centroid
closest_point = ClosestPoint(Point=area_4.Centroid, Cloud=area_2.Centroid)  # -> ClosestPoint, CPIndex, Distance
point_in_curve_2 = PointInCurve(Point=area_5.Centroid, Curve=region_union_2)  # -> Relationship, Point
point = Point(Point(-177.4758106, -83.64429501, 0))
surface_4 = Surface(orient_2.Geometry)
panel_5 = Panel(point_in_curve_2.Relationship)
point_2 = GetPoint(point, AtLeast=1, AtMost=2147483647, Realtime=True)
area_6 = Area(Geometry=surface_4)  # -> Area, Centroid
tree_branch_3 = TreeBranch(Tree=merge, Path=closest_point.CPIndex, MaintainPaths=True)
member_index = MemberIndex(Set=panel_5, Member="2")  # -> Index, Count
list_item = ListItem(List=gradient, Index=closest_point.CPIndex, Wrap=True)
panel_6 = Panel(point)
tree_branch_4 = TreeBranch(Tree=merge, Path=member_index.Index, MaintainPaths=True)
closest_point_2 = ClosestPoint(Point=point_2, Cloud=area_6.Centroid)  # -> ClosestPoint, CPIndex, Distance
panel_7 = Panel(tree_branch_3)
mesh_colours = MeshColours(Mesh=graft(surface_3), Colours=graft(list_item))
list_item_2 = ListItem(List=surface, Index=member_index.Index, Wrap=True)
list_item_3 = ListItem(List=surface_4, Index=closest_point_2.CPIndex, Wrap=True)
list_item_4 = ListItem(List=gradient, Index=member_index.Index, Wrap=True)

# ---- group: RH_OUT:hex
# Selected Hexagon
crv = Curve(list_item_3)

# ----
boolean_toggle = BooleanToggle(False)
mesh_colours_2 = MeshColours(Mesh=graft(list_item_2), Colours=graft(list_item_4))
area_7 = Area(Geometry=surface_3)  # -> Area, Centroid
# All Scores
mass_addition_2 = MassAddition(Input=tree_branch_4)  # -> flatten(Result), PartialResults
# Least area Scores
area_8 = Area(Geometry=list_item_2)  # -> Area, Centroid
# Selected area Scores
tree_branch_5 = TreeBranch(Tree=merge, Path=closest_point_2.CPIndex, MaintainPaths=True)
area_9 = Area(Geometry=crv)  # -> Area, Centroid
rh_in_lowestonly = Boolean(False)
unit_x = UnitX(Factor=1)
bounds_4 = Bounds(Numbers=mass_addition_2.Result)
closest_point_3 = ClosestPoint(Point=area_7.Centroid, Cloud=area_8.Centroid)  # -> ClosestPoint, CPIndex, Distance
stream_filter = StreamFilter(Gate=rh_in_lowestonly, Stream0=mesh_colours_2, Stream1=mesh_colours)
remap_numbers_4 = RemapNumbers(Value=mass_addition_2.Result, Source=bounds_4, Target=Domain(1, 10))  # -> Mapped, Clipped
round_to_decimal_place = RoundToDecimalPlace(NumberX=remap_numbers_4.Mapped, DecimalPlace=Slider(1, range=0..10), RoundType=0)  # -> Rounded, Difference
point_3 = Point(Point(694.9929849, -133.6935235, 0))
line_sdl = LineSDL(Start=point_3, Direction=expr("-x", unit_x), Length=Slider(100, range=0..100))
end_points = EndPoints(Curve=line_sdl)  # -> Start, End
stream_filter_2 = StreamFilter(Gate=rh_in_lowestonly, Stream0=area_8.Centroid, Stream1=area_7.Centroid)  # -> flatten(Stream)
list_item_5 = ListItem(List=round_to_decimal_place.Rounded, Index=closest_point_3.CPIndex, Wrap=True)
stream_filter_3 = StreamFilter(Gate=rh_in_lowestonly, Stream0=round_to_decimal_place.Rounded, Stream1=list_item_5)  # -> flatten(Stream)
line = Line(StartPoint=end_points.End, EndPoint=area_9.Centroid)
panel_8 = Panel(tree_branch_5)
text = Text("Arial")
number_slider_2 = Slider(5, range=0..100)
bool = Boolean(False)
boolean_toggle_2 = BooleanToggle(True)
# number of education facilities per capita
# Area of commercial to residential in a hexagon
list_length = ListLength(List=tree_branch_5)  # -> flatten(Length)
round_to_decimal_place_2 = RoundToDecimalPlace(NumberX=panel_8, DecimalPlace=Slider(3, range=0..10), RoundType=0)  # -> graft(Rounded), Difference
flip_plane = FlipPlane(Plane=stream_filter_2, ReverseX=invert(False), ReverseY=invert(False), SwapAxes=invert(True))
unit_y = UnitY(Factor=1)
c_script = CSharpScript(
    face=text,
    bold=bool,
    italics=boolean_toggle_2,
    size=number_slider_2,
    content=flatten(stream_filter_3),
    pl=flatten(flip_plane))  # -> out, simplify(A); inputs face: String, bold: Boolean, italics: Boolean, size: Double, content: String, pl: Plane
# ---------- c_script: C# usings ----------
using System.IO;
using System.Linq;
using System.Data;
using System.Drawing;
using System.Reflection;
using System.Windows.Forms;
using System.Xml;
using System.Xml.Linq;
using System.Runtime.InteropServices;

using Rhino.DocObjects;
using Rhino.Collections;
using GH_IO;
using GH_IO.Serialization;
# ---------- c_script: C# ----------
    if(size == 0)
      size = 1;

    if(!string.IsNullOrEmpty(face) && size > 0 && !string.IsNullOrEmpty(content) &&
      pl.IsValid)
    {
      using (var doc = Rhino.RhinoDoc.CreateHeadless(null))
      {
        var te = doc.Objects.AddText(content, pl, size, face, bold, italics);
        var txt = doc.Objects.Find(te) as Rhino.DocObjects.TextObject;

        if(txt != null)
        {
          var tt = txt.Geometry as Rhino.Geometry.TextEntity;
          A = tt.Explode();
        }
      }
    }
# ---------- end c_script ----------
line_sdl_2 = LineSDL(Start=point_3, Direction=unit_y, Length=Slider(139, range=0..1000))
# Keshava's Metrics
# Mass to void ratio in hexagon
# Closest distance to healthcare
# Closest distance to Parks
# Amenities per capita
divide_curve = DivideCurve(Curve=line_sdl_2, Count=list_length, Kinks=False)  # -> Points, Tangents, Parameters
flip_plane_2 = FlipPlane(Plane=divide_curve.Points, ReverseX=invert(False), ReverseY=invert(False), SwapAxes=invert(True))
# Area of Green Space per capita
panel_9 = Panel("Amenities per capita")
# Population density in hexagon
panel_10 = Panel("Area of Green Space per capita")

# ---- group: ClassMesh
mesh = Mesh(simplify(flatten(stream_filter)))

# ---- group: RH_OUT:LeastHex
curve_3 = Curve(surface_3)

# ---- group: RH_OUT:Scores
curve_4 = Curve(c_script.A)

# ----
merge_2 = Merge(
    Data1="Mass to Void Ratio",
    Data2="Distance to healthcare",
    Data3="Distance to Parks",
    Data4=panel_9,
    Data5="Education facilities per capita",
    Data6=panel_10,
    Data7="Area of commercial to residential",
    Data8="Population density")  # -> graft(Result)
concatenate = Concatenate(Fragment_A=merge_2, Fragment_B="   //    ", A=round_to_decimal_place_2.Rounded)  # -> simplify(Result)
c_script_2 = CSharpScript(
    face=text,
    bold=bool,
    italics=boolean_toggle_2,
    size=number_slider_2,
    content=flatten(concatenate),
    pl=flatten(flip_plane_2))  # -> out, simplify(A); inputs face: String, bold: Boolean, italics: Boolean, size: Double, content: String, pl: Plane; same code as c_script

# ---- group: RH_OUT:Legend
curve_5 = Curve(c_script_2.A)

# ----
bounding_rectangle = BoundingRectangle(Geometry=flatten(curve_5), Plane=PlaneXY(0, 0, 0), Axis=0, Slide=0, Union=True)  # -> Bounding, DimensionX, DimensionY
area_10 = Area(Geometry=bounding_rectangle.Bounding)  # -> Area, Centroid
scale_3 = Scale(Geometry=bounding_rectangle.Bounding, Center=area_10.Centroid, Factor=Slider(1.2, range=0..10))  # -> Geometry, Transform

# ---- group: RH_OUT:Rect
curve_6 = Curve(scale_3.Geometry)
